test file "test"
  coverage: Decision

suite "KY24AppMain/PwmInTargetSpeedEval/PwmInSpeedCtrl/FreqValidJudge"

  suite "KY24V_190826_Harness14"

    case "Group 1" [baseline]
      model KY24AppMain, harness KY24V_190826_Harness14 (for KY24AppMain/PwmInTargetSpeedEval/PwmInSpeedCtrl/FreqValidJudge)
      signal scenario: Group 1

suite "KY24AppMain/ECUFaultDiag/AmbTemperatureDiag"

  case "KY24V_190826_Harness1" [baseline]
    model KY24AppMain, harness KY24V_190826_Harness1 (for KY24AppMain/ECUFaultDiag/AmbTemperatureDiag)

suite "KY24AppMain/PwmInTargetSpeedEval/PwmInSpeedCtrl/DutyFilter/DutyFilter/BufDataSameFirstCnt"

  case "KY24V_190826_Harness3" [baseline]
    model KY24AppMain, harness KY24V_190826_Harness3 (for KY24AppMain/PwmInTargetSpeedEval/PwmInSpeedCtrl/DutyFilter/DutyFilter/BufDataSameFirstCnt)

suite "KY24AppMain/PwmInTargetSpeedEval/PwmInSpeedCtrl/DutyFilter/DutyFilter/DutyBufUpdate"

  case "KY24V_190826_Harness5" [baseline]
    model KY24AppMain, harness KY24V_190826_Harness5 (for KY24AppMain/PwmInTargetSpeedEval/PwmInSpeedCtrl/DutyFilter/DutyFilter/DutyBufUpdate)

suite "KY24AppMain/DelayOut/DelayOut"

  suite "KY24V_190826_Harness6"

    case "Group 1" [baseline]
      model KY24AppMain, harness KY24V_190826_Harness6 (for KY24AppMain/DelayOut/DelayOut)
      signal scenario: Group 1

suite "KY24AppMain/DelayOut1/DelayOut"

  suite "KY24V_190826_Harness21"

    case "Group 1" [baseline]
      model KY24AppMain, harness KY24V_190826_Harness21 (for KY24AppMain/DelayOut1/DelayOut)
      signal scenario: Group 1

suite "KY24AppMain/PwmInTargetSpeedEval/PwmInSpeedCtrl/SpeedDelayOut/DelayOut"

  suite "KY24V_190826_Harness24"

    case "Group 1" [baseline]
      model KY24AppMain, harness KY24V_190826_Harness24 (for KY24AppMain/PwmInTargetSpeedEval/PwmInSpeedCtrl/SpeedDelayOut/DelayOut)
      signal scenario: Group 1

suite "KY24AppMain/PwmInTargetSpeedEval/PwmInSpeedCtrl/SpeedAndOutDelayEval/SpeedCurve"

  case "KY24V_190826_Harness2" [baseline]
    model KY24AppMain, harness KY24V_190826_Harness2 (for KY24AppMain/PwmInTargetSpeedEval/PwmInSpeedCtrl/SpeedAndOutDelayEval/SpeedCurve)

suite "KY24AppMain/ECUFaultDiag/VoltageDiag/HysteresisState"

  case "lib1_Harness1" [baseline]
    model KY24AppMain, harness lib1_Harness1 (for KY24AppMain/ECUFaultDiag/VoltageDiag/HysteresisState)

suite "KY24AppMain/ECUFaultDiag/AmbTemperatureDiag/HysteresisState"

  case "lib1_Harness2" [baseline]
    model KY24AppMain, harness lib1_Harness2 (for KY24AppMain/ECUFaultDiag/AmbTemperatureDiag/HysteresisState)

suite "KY24AppMain/ECUFaultDiag/VoltageDiag"

  case "KY24V_190826_Harness17" [baseline]
    model KY24AppMain, harness KY24V_190826_Harness17 (for KY24AppMain/ECUFaultDiag/VoltageDiag)

suite "KY24AppMain/MotorRestartAndFaultCnt"

  case "KY24V_190826_Harness8" [baseline]
    model KY24AppMain, harness KY24V_190826_Harness8 (for KY24AppMain/MotorRestartAndFaultCnt)

suite "KY24AppMain/MotorRestartAndFaultCnt/MotorFaultRecoverTimer"

  suite "KY24V_190826_Harness9"

    case "Group 1" [baseline]
      model KY24AppMain, harness KY24V_190826_Harness9 (for KY24AppMain/MotorRestartAndFaultCnt/MotorFaultRecoverTimer)
      signal scenario: Group 1

suite "KY24AppMain/MotorRestartAndFaultCnt/MotorFaultRecoverTimer/IntervalTimeAndFaultCntEval"

  case "KY24V_190826_Harness10" [baseline]
    model KY24AppMain, harness KY24V_190826_Harness10 (for KY24AppMain/MotorRestartAndFaultCnt/MotorFaultRecoverTimer/IntervalTimeAndFaultCntEval)

suite "KY24AppMain/MotorRestartAndFaultCnt/MotorFaultRecoverTimer/IntervalTimeAndFaultCntEval/CalcRecoverWaitTimeTHR"

  case "KY24V_190826_Harness11" [baseline]
    model KY24AppMain, harness KY24V_190826_Harness11 (for KY24AppMain/MotorRestartAndFaultCnt/MotorFaultRecoverTimer/IntervalTimeAndFaultCntEval/CalcRecoverWaitTimeTHR)

suite "KY24AppMain/MotorRestartAndFaultCnt/MotorFaultRecoverTimer/IntervalTimeAndFaultCntEval/FaultCode2Index"

  case "KY24V_190826_Harness12" [baseline]
    model KY24AppMain, harness KY24V_190826_Harness12 (for KY24AppMain/MotorRestartAndFaultCnt/MotorFaultRecoverTimer/IntervalTimeAndFaultCntEval/FaultCode2Index)

suite "KY24AppMain/MotorRestartAndFaultCnt/MotorFaultRecoverTimer/IntervalTimeAndFaultCntEval/MotorFaultCntAddOne"

  case "KY24V_190826_Harness15" [baseline]
    model KY24AppMain, harness KY24V_190826_Harness15 (for KY24AppMain/MotorRestartAndFaultCnt/MotorFaultRecoverTimer/IntervalTimeAndFaultCntEval/MotorFaultCntAddOne)

suite "KY24AppMain/MotorRestartAndFaultCnt/MotorFaultRecoverTimer/MotorRestartFSM"

  case "KY24V_190826_Harness16" [baseline]
    model KY24AppMain, harness KY24V_190826_Harness16 (for KY24AppMain/MotorRestartAndFaultCnt/MotorFaultRecoverTimer/MotorRestartFSM)

suite "KY24AppMain/PwmInTargetSpeedEval"

  case "KY24V_190826_Harness7" [baseline]
    model KY24AppMain, harness KY24V_190826_Harness7 (for KY24AppMain/PwmInTargetSpeedEval)